# Grasshopper definition cabinet2.gh (Grasshopper 0.9.76)
# plug-ins: Python Interpreter, Telepathy

panel = Panel("""18
18
18""")
bang = ExplodeTree(Data=simplify(graft(panel)))  # -> Branch0, Branch1, Branch2
panel_2 = Panel("6")
panel_3 = Panel("1")
box = DomainBox(Base=PlaneXY(0, 0, 0), X=bang.Branch0, Y=bang.Branch1, Z=bang.Branch2)
list = ValueList({"1/4": .25, "1/2": .5, "3/4": .75, "6mm": .236, "12mm": .472}, selected="1/4")
list_2 = ValueList({"1/4": .25, "1/2": .5, "3/4": .75, "6mm": .236, "12mm": .472}, selected="3/4")
list_3 = ValueList({"1/4": .25, "1/2": .5, "3/4": .75, "6mm": .236, "12mm": .472}, selected="3/4")
list_4 = ValueList({"1/4": .25, "1/2": .5, "3/4": .75, "6mm": .236, "12mm": .472}, selected="1/4")
list_5 = ValueList({"1/4": .25, "3/8": .375, "1/2": .5, "3/4": .75, "6mm": .236, "12mm": .472}, selected="1/2")
list_6 = ValueList({"1/4": .25, "3/8": .375, "1/2": .5, "3/4": .75, "6mm": .236, "12mm": .472}, selected="3/4")
list_7 = ValueList({"1/4": .25, "3/8": .375, "1/2": .5, "3/4": .75, "6mm": .236, "12mm": .472}, selected="3/8")
list_8 = ValueList({"1/4": .25, "3/8": .375, "1/2": .5, "3/4": .75, "6mm": .236, "12mm": .472}, selected="1/2")
python = PythonScript(b=box, caseThickness=list_3, tenonThickness=list_4, mortiseDepth=list_5, backThickness=list_6)  # -> out, top, bottom, left, right, back; inputs b: Brep
# ---------- python: Python ----------
import Rhino as r
import Rhino.Geometry.Point3d as pt

a = []

edges = b.Curves3D

bottomEdges = [edges[0],edges[1],edges[2],edges[3]]
topEdges = [edges[4],edges[5],edges[6],edges[7]]
leftEdges = [edges[3],edges[8],edges[7],edges[11]]
rightEdges = [edges[1],edges[10],edges[5],edges[9]]
backEdges = [edges[2],edges[10],edges[6],edges[11]]
frontEdges = [edges[0],edges[9],edges[4],edges[8]]

def makeBottom(edgeList):
    #direction: 1 for bottom, -1 for top 
    t0 = edgeList[0].Domain[0]
    t1 = edgeList[0].Domain[1]
    vU = r.Geometry.Vector3d(0,backThickness+.5,0)
    vD = r.Geometry.Vector3d(0,-backThickness-.5,0)
    vL = r.Geometry.Vector3d(-mortiseDepth,0,0)
    vR = r.Geometry.Vector3d(mortiseDepth,0,0)
    vZ = r.Geometry.Vector3d(0,0,tenonThickness)
    ptA0 = edgeList[0].PointAt(t0+caseThickness)
    ptA1 = pt.Add(ptA0,vU)
    ptA2 = pt.Add(ptA1,vL)
    ptA3 = pt.Add(ptA0,vZ)
    ptB0 = edgeList[0].PointAt(t1-caseThickness)
    ptB1 = pt.Add(ptB0,vU)
    ptB2 = pt.Add(ptB1,vR)
    ptB3 = pt.Add(ptB0,vZ)
    ptC0 = edgeList[2].PointAt(t0+caseThickness)
    ptC1 = pt.Add(ptC0,vD)
    ptC2 = pt.Add(ptC1,vR)
    ptC3 = pt.Add(ptC0,vZ)
    ptD0 = edgeList[2].PointAt(t1-caseThickness)
    ptD1 = pt.Add(ptD0,vD)
    ptD2 = pt.Add(ptD1,vL)
    ptD3 = pt.Add(ptD0,vZ)
    bottomPts = [ptA0,ptB0,ptB1,ptB2,ptC2,ptC1,ptC0,ptD0,ptD1,ptD2,ptA2,ptA1,ptA0]
    tenonRight = r.Geometry.PolylineCurve([ptB3,ptC3])
    tenonLeft = r.Geometry.PolylineCurve([ptD3,ptA3])
    bottomOutline = r.Geometry.PolylineCurve(bottomPts)
    return [bottomOutline, tenonRight, tenonLeft]

def makeSide(edgeList, direction):
    #direction: 1 for left side, -1 for right side
    t0 = edgeList[0].Domain[0]
    t1 = edgeList[0].Domain[1]
    vI = r.Geometry.Vector3d(direction*(caseThickness-mortiseDepth),0,0) #inside
    vIR = r.Geometry.Vector3d(direction*.25,0,0) #inside Rabbet
    vU = r.Geometry.Vector3d(0,0,caseThickness-tenonThickness)
    vD = r.Geometry.Vector3d(0,0,tenonThickness-caseThickness)
    ptA = edgeList[0].PointAt(t0+backThickness+.5)
    ptA = pt.Add(ptA,vU)
    ptA = pt.Add(ptA,vI)
    ptB = edgeList[0].PointAt(t1-backThickness-.5)
    ptB = pt.Add(ptB,vU)
    ptB = pt.Add(ptB,vI)
    ptB1 = edgeList[0].PointAt(t0+backThickness)
    ptB1 = pt.Add(ptB1,vU)
    ptB1 = pt.Add(ptB1,vIR)
    ptC = edgeList[2].PointAt(t0+backThickness+.5)
    ptC = pt.Add(ptC,vD)
    ptC = pt.Add(ptC,vI)
    ptC1 = edgeList[2].PointAt(t0+backThickness)
    ptC1 = pt.Add(ptC1,vD)
    ptC1 = pt.Add(ptC1,vIR)
    ptD = edgeList[2].PointAt(t1-backThickness-.5)
    ptD = pt.Add(ptD,vD)
    ptD = pt.Add(ptD,vI)
    mortiseBottom = r.Geometry.PolylineCurve([ptA,ptB])
    mortiseTop = r.Geometry.PolylineCurve([ptC,ptD])
    backRabbet = r.Geometry.PolylineCurve([ptC1,ptB1])
    sideOutline = r.Geometry.Curve.JoinCurves(edgeList)
    return [sideOutline[0], mortiseBottom, mortiseTop, backRabbet]

def makeBack(edgeList):
    t0 = edgeList[0].Domain[0]
    t1 = edgeList[0].Domain[1]
    vU = r.Geometry.Vector3d(0,0,caseThickness)
    vD = r.Geometry.Vector3d(0,0,-caseThickness)
    ptA = edgeList[0].PointAt(t0+.25)
    ptA = pt.Add(ptA,vU)
    ptB = edgeList[0].PointAt(t1-.25)
    ptB = pt.Add(ptB,vU)
    ptC = edgeList[2].PointAt(t1-.25)
    ptC = pt.Add(ptC,vD)
    ptD = edgeList[2].PointAt(t0+.25)
    ptD = pt.Add(ptD,vD)
    backOutline = r.Geometry.PolylineCurve([ptA,ptB,ptC,ptD,ptA])
    return backOutline

#a = makeBottom(bottomEdges)
#a = makeSide(leftEdges)
bottom = makeBottom(bottomEdges)
left = makeSide(leftEdges, 1)
right = makeSide(rightEdges, -1)
top = makeBottom(topEdges)
back = makeBack(backEdges)
# ---------- end python ----------
mat_tenonthickness = RemoteSender(list_7)
mat_toprailwidth = RemoteSender("6")
mat_shoulderwidth = RemoteSender("1")
mat_casethickness = RemoteSender(list_2)
mat_tenondepth = RemoteSender(list_8)
mat_backthickness = RemoteSender(list)
crv = Curve(python.bottom)
crv_2 = Curve(python.left)
crv_3 = Curve(python.back)
group = Group(Objects=crv)
group_2 = Group(Objects=crv_2)
group_3 = Group(Objects=crv_3)
boxfaces = PythonScript()  # -> out, top, bottom, front, back, left, right, a; inputs box: Brep
# ---------- boxfaces: Python ----------
import Rhino as r
a = []

for face in box.Faces:
    #normal = face.TryGetPlane(0)[1].Normal
    u = face.Domain(0)
    v = face.Domain(1)
    normal = face.NormalAt(u[0],v[0])
    a.append(face.DuplicateFace(face))
    if (normal.VectorAngle(normal,(r.Geometry.Vector3d(0,-1,0)))==0):
            front = face.DuplicateFace(face)
    elif (normal.VectorAngle(normal,(r.Geometry.Vector3d(1,0,0)))==0):
            right = face.DuplicateFace(face)
    elif (normal.VectorAngle(normal,(r.Geometry.Vector3d(0,1,0)))==0):
            back = face.DuplicateFace(face)
    elif (normal.VectorAngle(normal,(r.Geometry.Vector3d(-1,0,0)))==0):
            left = face.DuplicateFace(face)
    elif (normal.VectorAngle(normal,(r.Geometry.Vector3d(0,0,-1)))==0):
            bottom = face.DuplicateFace(face)
    elif (normal.VectorAngle(normal,(r.Geometry.Vector3d(0,0,1)))==0):
            top = face.DuplicateFace(face)
    else:
        print("Non-orthoganal face detected")
        print(normal.VectorAngle(normal,(r.Geometry.Vector3d(-1,0,0))))
# ---------- end boxfaces ----------
